# Grasshopper definition CSV import.gh (Grasshopper 0.9.76)

path = FilePath("C:\Users\Mateusz\Desktop\Book1.csv")
csv_ts = CSharpScript(F=path, Reference=["D:\OneDrive\Builds\Owl\Owl.Core.dll", "D:\OneDrive\Builds\Owl\Owl.GH.Common.dll"])  # -> A; inputs F: String
# ---------- csv_ts: C# ----------
    Owl.Core.Tensors.TensorSet ts = new Owl.Core.Tensors.TensorSet();

    string filepath = F;
    string alltext = File.ReadAllText(filepath);

    string[] lines = alltext.Split('\n');

    foreach (string line in lines)
    {
      if (line != string.Empty) {
        string[] values = line.Split(',');
        Owl.Core.Tensors.Tensor tens = new Tensor(values.Length);

        int counter = 0;

        foreach (string val in values)
        {
          double thisvalue = double.Parse(val);
          tens[counter] = thisvalue;
          counter += 1;
        }

        ts.Add(tens);
      }
    }

    A = new GH_OwlTensorSet(ts);
# ---------- end csv_ts ----------
panel = Panel(csv_ts)
