# Grasshopper definition Language recognition.gh (Grasshopper 0.9.76)
# plug-ins: Anemone, Owl.Accord.GH, Owl.GH

panel = Panel("""On the 9th. William Findley and David Redick--deputed by the Committee of Safety (as it is designated) which met on the 2d. of this month at Parkinson Ferry arrived in Camp with the Resolutions of the said Committee; and to give information of the State of things in the four Western Counties of Pennsylvania to wit--Washington Fayette Westd. & Alligany in order to see if it would prevent the March of the Army into them.

At 10 oclock I had a meeting with these persons in presence of Govr. Howell (of New Jersey) the Secretary of the Treasury, Colo. Hamilton, & Mr. Dandridge: Govr. Mifflin was invited to be present, but excused himself on acct. of business.

I told the Deputies that by one of the Resolutions it would appear that they were empowered to give information of the disposition & of the existing state of matters in the four Counties above men[tioned]; that I was ready to hear & would listen patiently, and with candour to what they had to say.

Mr. Findley began. He confined his information to such parts of the four Counties as he was best acquainted with; referring to Mr. Reddick for a recital of what fell within his knowledge, in the other parts of these Counties.

The substance of Mr. Findleys communications were as follows--viz.--That the People in the parts where he was best acquainted, had seen there folly; and he believed were disposed to submit to the Laws; that he thought, but could not undertake to be responsible, for the re-establishment of the public Offices for the Collection of the Taxes on distilled spirits, & Stills--intimating however, that it might be best for the present, & until the peoples minds were a little more tranquilized, to hold the Office of Inspection at Pitsburgh under the protection--or at least under the influence of the Garrison; That he thought the Distillers would either enter their stills or would put them down; That the Civil authority was beginning to recover its tone; & enumerated some instances of it; That the ignorance, & general want of information among the people far exceeded any thing he had any conception of; That it was not merely the excise law their opposition was aimed at, but to all law, & Government; and to the Officers of Government; and that the situation in which he had been, & the life he had led for sometime, was such, that rather than go through it again, he would prefer quitting this scene altogether.

Mr. Redicks information was similar to the above; except as to the three last recitals--on wch. I do not recollect that he expressed any sentiment further than that the situation of those who were not in the opposition to government whilst the frenzy was at its height, were obliged to sleep with their Arms by their bed Sides every night; not knowing but that before Morning they might have occasion to use them in defence of their persons, or their properties.

He added, that for a long time after the riots commenced, and until lately, the distrust of one another was such, that even friends were affraid to communicate their sentiments to each other; That by whispers this was brought about; and growing bolder as they became more communicative they found their strength, and that there was a general disposition not only to acquiesce under, but to support the Laws--and he gave some instances also of Magistrates enforcing them.

He said the People of those Counties believed that the opposition to the Excise law--or at least that their dereliction to it, in every other part of the U. States was similar to their own, and that no Troops could be got to March against them for the purpose of coercion; that every acct. until very lately, of Troops marching against them was disbelieved; & supposed to be the fabricated tales of governmental men; That now they had got alarmed; That many were disposing of their property at an under rate, in order to leave the Country, and added (I think) that they wd. go to Detroit. That no person of any consequence, except one, but what had availed themselves of the proffered amnesty; That those who were still in the opposition, and obnoxious to the laws, were Men of little or no property, & cared but little where they resided; That he did not believe there was the least intention in them to oppose the Army; & that there was not three rounds of ammunition for them in all the Western Country. He (& I think Mr. Findley also) was apprehensive that the resentments of the Army might be productive of treatment to some of these people that might be attended with disagreeable consequences; & on that account seemed to deprecate the March of it: declaring however, that it was their wish, if the people did not give proofs of unequivocal submission, that it might not stop short of its object.

After hearing what both had to say, I briefly told them--That it had been the earnest wish of governmt. to bring the people of those counties to a sense of their duty, by mild, & lenient means; That for the purpose of representing to their sober reflection the fatal consequences of such conduct Commissioners had been sent amongst them that they might be warned, in time, of what must follow, if they persevered in their opposition to the laws; but that coercion wou'd not be resorted to except in the dernier resort: but, that the season of the year made it indispensible that preparation for it should keep pace with the propositions that had been made; That it was unnecessary for me to enumerate the transactions of those people (as they related to the proceedings of government) forasmuch as they knew them as well as I did; That the measure which they were not witness to the adoption of was not less painful than expensive--Was inconvenient, & distressing--in every point of view; but as I considered the support of the Laws as an object of the first magnitude, and the greatest part of the expense had already been incurred, that nothing Short of the most unequivocal proofs of absolute Submission should retard the March of the army into the Western counties, in order to convince them that the government could, & would enforce obedience to the laws--not suffering them to be insulted with impunity. Being asked again what proofs would be required, I answered, they knew as well as I did, what was due to justice & example. They understood my meaning--and asked if they might have another interview. I appointed five oclock in the After noon for it. At this second Meeting there was little more than a repeti[ti]on of what had passed in the forenoon; and it being again mentioned that all the principal characters, except one, in the Western counties who had been in the opposition, had submitted to the propositions--I was induced, seeing them in the Street the next day, to ask Mr. Redick who that one was?--telling him at the same time I required no disclosure that he did not feel himself entirely free to make. He requested a little time to think of it, and asked for another meeting--which was appointed at 5 oclock that afternoon--which took place accordingly when he said David Bradford was the person he had alluded to in his former conversations.""")
panel_2 = Panel("""Die Küchenuhr
Wolfgang Borchert

Sie sahen ihn schon von weitem auf sich zukommen, denn er fiel auf. Er hatte ein ganz altes Gesicht, aber wie er ging, daran sah man, dass er erst zwanzig war. Er setzte sich mit seinem alten Gesicht zu ihnen auf die Bank. Und dann zeigte er ihnen, was er in der Hand trug.
Das war unsere Küchenuhr, sagte er und sah sie alle der Reihe nach an, die auf der Bank in der Sonne saßen. Ja, ich habe sie noch gefunden. Sie ist übrig geblieben. Er hielt eine runde tellerweiße Küchenuhr vor sich hin und tupfte mit dem Finger die blau gemalten Zahlen ab.
Sie hat weiter keinen Wert, meinte er entschuldigend, das weiß ich auch. Und sie ist auch nicht besonders schön. Sie ist nur wie ein Teller, so mit weißem Lack. Aber die blauen Zahlen sehen doch ganz hübsch aus, finde ich. Die Zeiger sind natürlich nur aus Blech. Und nun gehen sie auch nicht mehr. Nein. Innerlich ist sie kaputt, das steht fest. Aber sie sieht noch aus wie immer. Auch wenn sie jetzt nicht mehr geht.
Er machte mit der Fingerspitze einen vorsichtigen Kreis auf dem Rand der telleruhr entlang. Und er sagte leise: Und sie ist übrig geblieben.
Die auf der Bank in der Sonne saßen, sahen ihn nicht an. Einer sah auf seine Schuhe und die Frau sah in ihren Kinderwagen. Dann sagte jemand:
Sie haben wohl alles verloren?
Ja, ja, sagte er freudig, denken Sie, aber auch alles! Nur sie hier, sie ist übrig. Und er hob die Uhr wieder hoch, als ob die anderen sie noch nicht kannten.
Aber sie geht doch nicht mehr, sagte die Frau.
Nein, nein, das nicht. Kaputt ist sie, das weiß ich wohl. Aber sonst ist sie doch noch ganz wie immer: weiß und blau. Und wieder zeigte er ihnen seine Uhr. Und was das Schönste ist, fuhr er aufgeregt fort, das habe ich Ihnen ja noch überhaupt nicht erzählt. Das Schönste kommt nämlich noch: Denken Sie mal, sie ist um halb drei Stehengeblieben. Ausgerechnet um halb drei, denken Sie mal.
Dann wurde Ihr Haus sicher um halb drei getroffen, sagte der Mann und schob wichtig die Unterlippe vor. Das habe ich schon oft gehört. Wenn die Bombe runtergeht, bleiben die Uhren stehen. Das kommt von dem Druck.
Er sah seine Uhr an und schütellte den Kopf. Nein, lieber Herr, nein, da irren Sie sich. das hat mit den Bomben nichts zu tun. Sie müssen nicht imer von den Bomben reden. Nein. Um halb drei war etwas ganz anderes, das wissen Sie nur nicht. Das ist nämlch der Witz, dass sie gerade um halb drei stehen geblieben ist. Und nicht um Viertel nach vier oder um sieben. Um halb drei kam ich nämlich immer nach Hause. Nachts, meine ich. Fast immer um halb drei. Das ist ja gerade der Witz.
Er sah die anderen an, aber sie hatten ihre Augen von ihm weggenommen. Er fand sie nicht. Da nickte er seiner Uhr zu: Dann hatte ich natürlich Hunger, nicht wahr? Und ich ging immer gleich in die Küche. Da war es dann fast immer halb drei. Und dann, dann kam nämlich meine Mutter. Ich konnte noch so leise die Tür aufmachen, sie hat hat mich immer gehört. Und wenn ich in der dunklen Küche etwas zu essen suchte, ging plötzlich das Licht an. Dann stand sie da in ihrer Wolljacke und mit einem roten Schal um. Und barfuß. Und dabei unsere Küche gekachelt. Und sie machte ihre Augen ganz klein, weil ihr das Licht so hell war. Denn sie hatte ja schon geschlafen. Es war ja Nacht.
So spät wieder, sagte sie dann. Mehr sagte sie nie. Nur: So spät wieder. Und dann machte sie mir das Abendbrot warm und sah zu, wie ich aß. Dabei scheuerte sie immer die Füße aneinander, weil die Kacheln so kalt waren. Schuhe zog sie nachts nie an. Und sie saß so lange bei mir, bis ich satt war. Und dann hörte ich sie noch die Teller wegsetzen, wenn ich in meinem Zimmer schon das Licht ausgemacht hatte. Jede Nacht war es so. Und meistens immer um halb drei. Das war ganz selbstverständlich, fand ich, dass sie mir nachts um halb drei in der Küche das Essen machte. Ich fand das ganz selbstverständlich. Sie tat das ja immer. Und sie hat nie mehr gesagt als: So spät wieder. Aber das sagte sie jedes Mal. Und ich dachte, das könnte nie aufhören. Es war mir so selbstverständlich. das alles war doch immer so gewesen.
Einen Atemzug lang war es still auf der Bank. Dann sagte er leise: Und jetzt? Er sah die anderen an. Aber er fand sie nicht. Da sagte er der Uhr leise ins weißblaue runde Gesicht: Jetzt, jetzt weiß ich, dass es das Paradies war. Das richtige Paradies. Auf der Bank war es ganz still. Dann fragte die Frau: Und Ihre Familie?
Er lächelte sie verlegen an: Ach, sie meinen meine Eltern? ja, die sind auch mit weg. Alles ist weg. Alles, stellen Sie sich vor. Alles weg.
Er lächelte verlegen von einem zum anderen. Aber sie sahen ihn nicht an. Da hob er wieder die Uhr hoch und lachte. Er lachte: Nur sie hier. Sie ist übrig. Und das Schönste ist ja, dass sie ausgerechnet um halb drei stehen geblieben ist. Ausgerechnet um halb drei.
Dann sagte er nichts mehr. Aber er hatte ein ganz altes Gesicht. Und der Mann, der neben ihm saß, sah auf seine Schuhe. Aber er sah seine Schuhe nicht. Er dachte immerzu an das Wort Paradies...""")
panel_3 = Panel("""Bibliothèque en ligne

Vous aimez lire ? Vous avez envie de découvrir ou redécouvrir certains chefs d’œuvre de la littérature ? Alors ce site est fait pour vous ! Lire en ligne référence et diffuse gratuitement les œuvres littéraires libres de droits, sous forme numérique mais également sous forme audio pour certaines œuvres. 

Découvrez également de nouveaux talents en lisant les textes des auteurs à découvrir de Lire en ligne !

Publication gratuite

Publiez en 1 clic !
Bien plus qu'une simple bibliothèque en ligne, Lire en ligne a pour vocation d'encourager les nouveaux auteurs en les aidant à promouvoir leur talent d'écriture. Nous vous offrons ainsi la possibilité de publier vos œuvres en ligne, de manière totalement gratuite.

Alors n'hésitez pas et faites connaître votre talent ! Pour cela, il suffit de vous créer un compte ; vous pourrez alors accéder à votre espace auteur et publier vos ouvrages à votre convenance.

A vos plumes, ou plutôt, à vos claviers !

Forum

Discuter, échanger, débattre, partager...
Notre forum, destiné aux lecteurs et aux auteurs de Lire en ligne, est un espace de discussion, d'échange, d’entraide et de partage autour de sujets littéraires ou non.

Qu'est-ce que le Lorem Ipsum?
Le Lorem Ipsum est simplement du faux texte employé dans la composition et la mise en page avant impression. Le Lorem Ipsum est le faux texte standard de l'imprimerie depuis les années 1500, quand un peintre anonyme assembla ensemble des morceaux de texte pour réaliser un livre spécimen de polices de texte. Il n'a pas fait que survivre cinq siècles, mais s'est aussi adapté à la bureautique informatique, sans que son contenu n'en soit modifié. Il a été popularisé dans les années 1960 grâce à la vente de feuilles Letraset contenant des passages du Lorem Ipsum, et, plus récemment, par son inclusion dans des applications de mise en page de texte, comme Aldus PageMaker.

Pourquoi l'utiliser?
On sait depuis longtemps que travailler avec du texte lisible et contenant du sens est source de distractions, et empêche de se concentrer sur la mise en page elle-même. L'avantage du Lorem Ipsum sur un texte générique comme 'Du texte. Du texte. Du texte.' est qu'il possède une distribution de lettres plus ou moins normale, et en tout cas comparable avec celle du français standard. De nombreuses suites logicielles de mise en page ou éditeurs de sites Web ont fait du Lorem Ipsum leur faux texte par défaut, et une recherche pour 'Lorem Ipsum' vous conduira vers de nombreux sites qui n'en sont encore qu'à leur phase de construction. Plusieurs versions sont apparues avec le temps, parfois par accident, souvent intentionnellement (histoire d'y rajouter de petits clins d'oeil, voire des phrases embarassantes).


D'où vient-il?
Contrairement à une opinion répandue, le Lorem Ipsum n'est pas simplement du texte aléatoire. Il trouve ses racines dans une oeuvre de la littérature latine classique datant de 45 av. J.-C., le rendant vieux de 2000 ans. Un professeur du Hampden-Sydney College, en Virginie, s'est intéressé à un des mots latins les plus obscurs, consectetur, extrait d'un passage du Lorem Ipsum, et en étudiant tous les usages de ce mot dans la littérature classique, découvrit la source incontestable du Lorem Ipsum. Il provient en fait des sections 1.10.32 et 1.10.33 du "De Finibus Bonorum et Malorum" (Des Suprêmes Biens et des Suprêmes Maux) de Cicéron. Cet ouvrage, très populaire pendant la Renaissance, est un traité sur la théorie de l'éthique. Les premières lignes du Lorem Ipsum, "Lorem ipsum dolor sit amet...", proviennent de la section 1.10.32.

L'extrait standard de Lorem Ipsum utilisé depuis le XVIè siècle est reproduit ci-dessous pour les curieux. Les sections 1.10.32 et 1.10.33 du "De Finibus Bonorum et Malorum" de Cicéron sont aussi reproduites dans leur version originale, accompagnée de la traduction anglaise de H. Rackham (1914).

Où puis-je m'en procurer?
Plusieurs variations de Lorem Ipsum peuvent être trouvées ici ou là, mais la majeure partie d'entre elles a été altérée par l'addition d'humour ou de mots aléatoires qui ne ressemblent pas une seconde à du texte standard. Si vous voulez utiliser un passage du Lorem Ipsum, vous devez être sûr qu'il n'y a rien d'embarrassant caché dans le texte. Tous les générateurs de Lorem Ipsum sur Internet tendent à reproduire le même extrait sans fin, ce qui fait de lipsum.com le seul vrai générateur de Lorem Ipsum. Iil utilise un dictionnaire de plus de 200 mots latins, en combinaison de plusieurs structures de phrases, pour générer un Lorem Ipsum irréprochable. Le Lorem Ipsum ainsi obtenu ne contient aucune répétition, ni ne contient des mots farfelus, ou des touches d'humour.""")
panel_4 = Panel("""Jak co roku obchody lanego poniedziałku w Bełchatowie wywołują wiele emocji. Święto to jest, co prawda, uświęcone tradycją, jednakże są ludzie, którzy zdecydowanie przesadzają z hołdowaniem tej jednej tradycji. „Świństwo, kiedyś to dziewczyny się perfumami lało, a nie tak, jak teraz, wiadrami; tałatajstwo!!!”, oburza się starszy pan, zapytany o opinię na temat nadchodzącego poniedziałku.

W ubiegłym roku śmigus- dyngus okazał się wyjątkowo mokry i wyjątkowo brzemienny w skutkach. W wyniku „niewinnych” igraszek z wodą doszło do wypadku samochodowego, w wyniku którego jedna osoba doznała poważnych obrażeń kręgosłupa. Było to na szczęście jedyne tak tragiczne wydarzenie owego dnia. 

Wczoraj o godzinie osiemnastej odbyło się zebranie Stowarzyszenia Bełchatowskich Rodzin, na którym omawiano drażniący problem lanego poniedziałku. Wysunięto także propozycję, aby na ulicę wyszły prewencyjnie liczniejsze niż zwykle patrole policji i straży miejskiej. Rodziny zaapelowały do młodzieży, żeby ta nie przesadzała z wodą. 

Tymczasem sama młodzież mówi, że nic złego się nigdy nie dzieje. „My się oblewamy między sobą, serio. Na pewno do żadnego dorosłego kolesia z butlami nie przylecimy. Nie wiem, czemu wszyscy tak się tego poniedziałku boją!”. Koledzy mojego rozmówcy tylko przytakują głowami. 

Nie ulega wątpliwości, że temat lanego poniedziałku wywołał liczne komentarze i wątpliwości, zarówno po stronie amatorów tego tradycyjnego polskiego obrzędu, jak i po stronie bełchatowian obawiających się o swoje bezpieczeństwo. Obecnie można tylko czekać na decyzję kompetentnych organów i poważnie się zastanowić nad problemem śmigusa- dyngusa. 
Skąd się to wzięło?
W przeciwieństwie do rozpowszechnionych opinii, Lorem Ipsum nie jest tylko przypadkowym tekstem. Ma ono korzenie w klasycznej łacińskiej literaturze z 45 roku przed Chrystusem, czyli ponad 2000 lat temu! Richard McClintock, wykładowca łaciny na uniwersytecie Hampden-Sydney w Virginii, przyjrzał się uważniej jednemu z najbardziej niejasnych słów w Lorem Ipsum – consectetur – i po wielu poszukiwaniach odnalazł niezaprzeczalne źródło: Lorem Ipsum pochodzi z fragmentów (1.10.32 i 1.10.33) „de Finibus Bonorum et Malorum”, czyli „O granicy dobra i zła”, napisanej właśnie w 45 p.n.e. przez Cycerona. Jest to bardzo popularna w czasach renesansu rozprawa na temat etyki. Pierwszy wiersz Lorem Ipsum, „Lorem ipsum dolor sit amet...” pochodzi właśnie z sekcji 1.10.32.

Standardowy blok Lorem Ipsum, używany od XV wieku, jest odtworzony niżej dla zainteresowanych. Fragmenty 1.10.32 i 1.10.33 z „de Finibus Bonorum et Malorum” Cycerona, są odtworzone w dokładnej, oryginalnej formie, wraz z angielskimi tłumaczeniami H. Rackhama z 1914 roku.

Skąd to wziąć?
Jest dostępnych wiele różnych wersji Lorem Ipsum, ale większość zmieniła się pod wpływem dodanego humoru czy przypadkowych słów, które nawet w najmniejszym stopniu nie przypominają istniejących. Jeśli masz zamiar użyć fragmentu Lorem Ipsum, lepiej mieć pewność, że nie ma niczego „dziwnego” w środku tekstu. Wszystkie Internetowe generatory Lorem Ipsum mają tendencje do kopiowania już istniejących bloków, co czyni nasz pierwszym prawdziwym generatorem w Internecie. Używamy zawierającego ponad 200 łacińskich słów słownika, w kontekście wielu znanych sentencji, by wygenerować tekst wyglądający odpowiednio. To wszystko czyni „nasz” Lorem Ipsum wolnym od powtórzeń, humorystycznych wstawek czy niecharakterystycznych słów.Czym jest Lorem Ipsum?
Lorem Ipsum jest tekstem stosowanym jako przykładowy wypełniacz w przemyśle poligraficznym. Został po raz pierwszy użyty w XV w. przez nieznanego drukarza do wypełnienia tekstem próbnej książki. Pięć wieków później zaczął być używany przemyśle elektronicznym, pozostając praktycznie niezmienionym. Spopularyzował się w latach 60. XX w. wraz z publikacją arkuszy Letrasetu, zawierających fragmenty Lorem Ipsum, a ostatnio z zawierającym różne wersje Lorem Ipsum oprogramowaniem przeznaczonym do realizacji druków na komputerach osobistych, jak Aldus PageMaker

Do czego tego użyć?
Ogólnie znana teza głosi, iż użytkownika może rozpraszać zrozumiała zawartość strony, kiedy ten chce zobaczyć sam jej wygląd. Jedną z mocnych stron używania Lorem Ipsum jest to, że ma wiele różnych „kombinacji” zdań, słów i akapitów, w przeciwieństwie do zwykłego: „tekst, tekst, tekst”, sprawiającego, że wygląda to „zbyt czytelnie” po polsku. Wielu webmasterów i designerów używa Lorem Ipsum jako domyślnego modelu tekstu i wpisanie w internetowej wyszukiwarce ‘lorem ipsum’ spowoduje znalezienie bardzo wielu stron, które wciąż są w budowie. Wiele wersji tekstu ewoluowało i zmieniało się przez lata, czasem przez przypadek, czasem specjalnie (humorystyczne wstawki itd).""")
number_slider = Slider(100, range=0..100)
case = TextCase(Text=panel_3, Culture=127)  # -> UpperCase, LowerCase
case_2 = TextCase(Text=panel_4, Culture=127)  # -> UpperCase, LowerCase
case_3 = TextCase(Text=panel_2, Culture=127)  # -> UpperCase, LowerCase
case_4 = TextCase(Text=panel, Culture=127)  # -> UpperCase, LowerCase
c_script = CSharpScript(x=case.LowerCase)  # -> out, A; inputs x: String
# ---------- c_script: C# ----------
    SetupDict();

    List<string> pairs = new List<string>();

    for (int i = 0; i < x.Length - 2; i++)
    {
      char first = x[i];
      char second = x[i + 1];
      if (IsValidPair(first, second)){pairs.Add(first.ToString() + second.ToString());}
    }

    A = pairs;
    Print(pairs.GetType().ToString());
# ---------- c_script: C# additional code ----------
  HashSet<char> nh = new HashSet<char>();

  public bool IsValidPair(char first, char second){
    return nh.Contains(first) && nh.Contains(second);
  }

  public void SetupDict(){
    nh.Clear();
    char[] all = " ,.abcdefghijklmnopqrstuvwxyz".ToCharArray();

    foreach (char thischar in all)
    {
      nh.Add(thischar);
    }
  }
# ---------- end c_script ----------
c_script_2 = CSharpScript(x=case_3.LowerCase)  # -> out, A; inputs x: String; same code as c_script
c_script_3 = CSharpScript(x=case_2.LowerCase)  # -> out, A; inputs x: String; same code as c_script
c_script_4 = CSharpScript(x=case_4.LowerCase)  # -> out, A; inputs x: String; same code as c_script
partition = PartitionList(List=c_script.A, Size=number_slider)
partition_2 = PartitionList(List=c_script_3.A, Size=number_slider)
partition_3 = PartitionList(List=c_script_2.A, Size=number_slider)
partition_4 = PartitionList(List=c_script_4.A, Size=number_slider)
c_script_5 = CSharpScript(x=partition, Reference=["D:\OneDrive\Builds\Owl\Owl.Core.dll", "D:\OneDrive\Builds\Owl\Owl.GH.Common.dll"])  # -> out, flatten(A); inputs x: list of String
# ---------- c_script_5: C# ----------
    SetupDict();
    SetupSrt();

    int[,] alldata = GetArray(x);
    //double[,] casted = new double[];


    Tensor tens = new Tensor(alldata.GetUpperBound(0) + 1, alldata.GetUpperBound(1) + 1);

    int cnt = 0;

    for (int i = 0; i < tens.get_ShapeAt(0); i++)
    {
      for (int j = 0; j < tens.get_ShapeAt(1); j++)
      {
        tens.TensorData[cnt] = (double) alldata[i, j];
        cnt++;
      }
    }

    A = new GH_OwlTensor(tens);
# ---------- c_script_5: C# additional code ----------
  HashSet<char> nh = new HashSet<char>();
  SortedList<char, int> srt = new SortedList<char, int>();

  public bool IsValidPair(char first, char second){
    return nh.Contains(first) && nh.Contains(second);
  }

  public int[,] GetArray(List<string> texts){
    int[,] table = new int[srt.Count, srt.Count];

    for (int i = 0; i < texts.Count; i++)
    {
      table[srt[texts[i][0]], srt[texts[i][1]]] += 1;
    }

    return table;
  }

  public void SetupSrt(){
    srt.Clear();
    int i = 0;
    foreach (char c in nh)
    {
      srt.Add(c, i);
      i++;
    }
  }

  public void SetupDict(){
    nh.Clear();
    char[] all = " ,.abcdefghijklmnopqrstuvwxyz".ToCharArray();

    foreach (char thischar in all)
    {
      nh.Add(thischar);
    }
  }
# ---------- end c_script_5 ----------
c_script_6 = CSharpScript(x=partition_3, Reference=["D:\OneDrive\Builds\Owl\Owl.Core.dll", "D:\OneDrive\Builds\Owl\Owl.GH.Common.dll"])  # -> out, flatten(A); inputs x: list of String; same code as c_script_5
c_script_7 = CSharpScript(x=partition_2, Reference=["D:\OneDrive\Builds\Owl\Owl.Core.dll", "D:\OneDrive\Builds\Owl\Owl.GH.Common.dll"])  # -> out, flatten(A); inputs x: list of String; same code as c_script_5
c_script_8 = CSharpScript(x=partition_4, Reference=["D:\OneDrive\Builds\Owl\Owl.Core.dll", "D:\OneDrive\Builds\Owl\Owl.GH.Common.dll"])  # -> out, flatten(A); inputs x: list of String; same code as c_script_5
tensorset = ConstructTensorSet(Tensors=c_script_5.A)
tensorset_2 = ConstructTensorSet(Tensors=c_script_6.A)
tensorset_3 = ConstructTensorSet(Tensors=c_script_7.A)
tensorset_4 = ConstructTensorSet(Tensors=c_script_8.A)
remap = RemapTSet(TensorSet=tensorset, Source="0 to 10", Target=Domain(0, 1))
remap_2 = RemapTSet(TensorSet=tensorset_2, Source="0 to 10", Target=Domain(0, 1))
remap_3 = RemapTSet(TensorSet=tensorset_3, Source="0 to 10", Target=Domain(0, 1))
remap_4 = RemapTSet(TensorSet=tensorset_4, Source="0 to 10", Target=Domain(0, 1))
panel_5 = Panel(c_script_4.A)
merge = Merge(Data1=remap_3, Data2=remap_4, Data3=remap_2, Data4=remap)
trimts = TrimTSet(TensorSet=merge, Range=Domain(0, 1))
pick = PickTensor(TensorSet=trimts, Indices=Slider(2, range=0..10), Wrap=True)
stats = TensorSetStats(TensorSet=trimts)  # -> Count, Homogeneity
_2dpreview = Tensor2DPreview(Tensor=pick, Range="0 to 0.5", SaveAll=False)
series = Series(Start=0, Step="0", Count="4")
series_2 = Series(Start=0, Step=1, Count="4")
dup = DuplicateData(Data=graft(series_2), Number=graft(stats.Count), Order=True)  # -> flatten(Data)
number_slider_2 = Slider(10, range=0..10)
replace = ReplaceItems(List=series, Item="1", Indices=graft(dup), Wrap=False)
series_3 = Series(Start=0, Step=number_slider_2, Count=10)
mergets = MergeTSet(TensorSets=trimts)
tensor = ConstructTensor(Values=replace)  # -> flatten(Tensor)
noise = AddNoise(TensorSet=mergets, Amplitude=Slider(0.03, range=0..0.1), Seed=series_3, Constrain=Domain(0, 1))
tensorset_5 = ConstructTensorSet(Tensors=tensor)
panel_6 = Panel("""29 * 29
50
4""")
dup_2 = DuplicateData(Data=tensorset_5, Number=number_slider_2, Order=True)
mergets_2 = MergeTSet(TensorSets=noise)
mergets_3 = MergeTSet(TensorSets=dup_2)
network = ConstructNetwork(Layers=panel_6, Activation=0, Alpha=Slider(0.3, range=0..1), Seed=123)
detset = DeconstructTensorSet(TensorSet=mergets_2)
detset_2 = DeconstructTensorSet(TensorSet=mergets_3)
loop_start = LoopStart(Repeat=Slider(100, range=0..100), Data=network)  # -> port, Counter, Data
jitter = Jitter(List=detset, Jitter=1, Seed=loop_start.Counter)  # -> Values, Indices
jitter_2 = Jitter(List=detset_2, Jitter=1, Seed=loop_start.Counter)  # -> Values, Indices
tensorset_6 = ConstructTensorSet(Tensors=jitter.Values)
tensorset_7 = ConstructTensorSet(Tensors=jitter_2.Values)
backex = BackpropagationEx(
    ActivationNetwork=loop_start.Data,
    Input=tensorset_6,
    Output=tensorset_7,
    LearningRate=0.01,
    Momentum=0.001,
    Iterations=Slider(100, range=0..100))  # -> ActivationNetwork, Error
clean = CleanTree(RemoveNulls=True, RemoveInvalid=True, RemoveEmpty=False, Tree=backex.ActivationNetwork)
compute = Compute(ActivationNetwork=backex.ActivationNetwork, Input=mergets)
lng = ListLength(List=clean)
filter = StreamFilter(Gate=lng, Stream1=backex.ActivationNetwork)
tsview = TensorSetDisplay(TensorSet=compute, Range=Domain(0, 1))
loop_paused = LoopPaused(port=loop_start.port, Exit=False, Data=flatten(filter), pausedState=True, state="Constant output", TimeOutVal=0)

c_script_9 = CSharpScript(x="break the")  # -> out, A; inputs x: String; same code as c_script
c_script_10 = CSharpScript(x=c_script_9.A, Reference=["D:\OneDrive\Builds\Owl\Owl.Core.dll", "D:\OneDrive\Builds\Owl\Owl.GH.Common.dll"])  # -> out, flatten(A); inputs x: list of String; same code as c_script_5
tensorset_8 = ConstructTensorSet(Tensors=c_script_10.A)

bounds = BoundsTSet(TensorSet=tensorset_8, Dimension=-1)

remap_5 = RemapTSet(TensorSet=tensorset_8, Source=bounds, Target=Domain(0, 1))

compute_2 = Compute(ActivationNetwork=loop_start.Data, Input=remap_5)
detset_3 = DeconstructTensorSet(TensorSet=compute_2)
panel_7 = Panel(detset_3)
