# Grasshopper definition Supervised.gh (Grasshopper 0.9.76)
# plug-ins: Owl.Accord.GH, Owl.GH

number_slider = Slider(5, range=0..10)
number_slider_2 = Slider(1000, range=0..1000)
pop3d = Populate3D(Region={Plane=PlaneXY(0, 0, 0), X=Domain(0, 1), Y=Domain(0, 1), Z=Domain(0, 1)}, Count=number_slider, Seed=number_slider)
nurbs = NurbsCurve(Vertices=pop3d, Degree=3, Periodic=False)  # -> Curve, Length, Domain
pipe = Pipe(Curve=nurbs.Curve, Radius=Slider(0.12, range=0..10), Caps=0)
pop3d_2 = Populate3D(
    Region={Plane=PlaneXY(0, 0, 0), X=Domain(0, 1), Y=Domain(0, 1), Z=Domain(0, 1)},
    Count=Slider(2000, range=0..10000),
    Seed=1)
cap = CapHoles(Brep=pipe)
pt = Point(pop3d_2)
panel = Panel("""0
0""")
brepinc = PointInBrep(Brep=cap, Point=pt, Strict=False)
replace = ReplaceItems(List=panel, Item=Slider(1, range=0..1), Indices=graft(brepinc), Wrap=False)
panel_2 = Panel("""3
6
4
2""")
num = Number(replace)
network = ConstructNetwork(Layers=panel_2, Activation=0, Alpha=2, Seed=123)

# ---- group: dataset
datatree_to_tensorset = DataTreeToTensorSet(DataTree=num)  # "DT->TS"
featurets = FeatureTensorSet(Feature0=pt)

# ----
backprop = Backpropagation(
    ActivationNetwork=network,
    Input=featurets,
    Output=datatree_to_tensorset,
    LearningRate=0.01,
    Momentum=0.001,
    Epoch=10,
    Iterations=Slider(100000, range=0..100000))  # -> ActivationNetwork, Error

# ---- group: dataset
detset = DeconstructTensorSet(TensorSet=datatree_to_tensorset)
detset_2 = DeconstructTensorSet(TensorSet=featurets)
panel_3 = Panel(detset_2)

# ---- group: use
compute = Compute(ActivationNetwork=backprop.ActivationNetwork, Input=featurets)
detset_3 = DeconstructTensorSet(TensorSet=compute)

# ----
panel_4 = Panel(backprop.Error)
range = Range(Domain=Domain(0, 1), Steps=Slider(40, range=0..100))
panel_5 = Panel(detset)
crossref = CrossReference(ListA=range, ListB=range, ListC=range, CrossMode=1)  # -> ListA, ListB, ListC
pt_2 = ConstructPoint(XCoordinate=crossref.ListA, YCoordinate=crossref.ListB, ZCoordinate=crossref.ListC)
featurets_2 = FeatureTensorSet(Feature0=pt_2)
compute_2 = Compute(ActivationNetwork=backprop.ActivationNetwork, Input=featurets_2)
panel_6 = Panel(detset_3)
detset_4 = DeconstructTensorSet(TensorSet=compute_2)
detensor = DeconstructTensor(Tensor=detset_4)
item = ListItem(List=detensor, Index=0, Wrap=True)  # -> flatten(Item)
smaller = SmallerThan(FirstNumber=item, SecondNumber=Slider(0.588, range=0..1))  # -> SmallerThan, OrEqualTo
cull = CullPattern(List=pt_2, CullPattern=smaller.SmallerThan)
cull_2 = CullPattern(List=item, CullPattern=smaller.SmallerThan)
gradient = Gradient(
    LowerLimit=0,
    UpperLimit=1,
    Parameter=cull_2,
    stops=[0: RGB(234, 38, 0), 0.25: RGB(234, 126, 0), 0.5: RGB(254, 244, 84), 0.75: RGB(173, 203, 249), 1: RGB(75, 107, 169)])
preview = CustomPreview(Geometry=cull, Shader=gradient)
