# Grasshopper definition T-Sne.gh (Grasshopper 0.9.76)
# plug-ins: Owl.Accord.GH, Owl.GH

pop3d = Populate3D(
    Region={Plane=PlaneXY(0, 0, 0), X=Domain(0, 30), Y=Domain(0, 30), Z=Domain(0, 30)},
    Count=Slider(30, range=0..100),
    Seed=1)
voronoi³ = Voronoi3D(Points=pop3d)  # -> Cells, Boundary
pop3d_2 = Populate3D(Region=voronoi³.Cells, Count=Slider(50, range=0..1000), Seed=1)
brepinc = PointInBrep(Brep=graft(voronoi³.Cells), Point=pop3d_2, Strict=False)
volume = Volume(Geometry=voronoi³.Cells)  # -> Volume, Centroid
cull = CullPattern(List=pop3d_2, CullPattern=brepinc)
scale = Scale(Geometry=cull, Center=graft(volume.Centroid), Factor=0.5)  # -> flatten(Geometry), Transform
featurets = FeatureTensorSet(Feature0=scale.Geometry)
t_sne = TSNE(Data=featurets, Perplexity=Slider(3, range=0..10), Theta=0.5, Outputs=Slider(2, range=0..10), Seed=123)
detset = DeconstructTensorSet(TensorSet=t_sne)
detensor = DeconstructTensor(Tensor=detset)
item = ListItem(List=detensor, Index=0, Wrap=True)  # -> Item, Item1
pt = ConstructPoint(XCoordinate=item.Item, YCoordinate=item.Item1, ZCoordinate=0)
ln = Line(StartPoint=scale.Geometry, EndPoint=flatten(pt))

loadtset = LoadTensorSet(LoadFile="C:\Users\Mateusz\Desktop\t10k-images.idx3-ubyte", Position=0, Count=-1)  # disabled
number_slider = Slider(9644696, range=0..100000000)  # disabled
detset_2 = DeconstructTensorSet(TensorSet=loadtset)  # disabled
box = Box({Plane=PlaneXY(-34.31337466, -31.95332161, 0), X=Domain(0, 0.5523030356), Y=Domain(0, 24.67216461), Z=Domain(0, 1.874225584)})
box_2 = Box({Plane=PlaneXY(-47.78230352, -7.291323429, 0), X=Domain(0, 3.487479932), Y=Domain(0, 22.14662093), Z=Domain(0, 11.8859398)})
box_3 = Box({Plane=PlaneXY(-46.475072, -27.42315363, 0), X=Domain(0, 11.09523487), Y=Domain(0, 9.105849844), Z=Domain(0, 2.981481748)})
box_4 = Box({Plane=PlaneXY(-24.07296159, -3.978407217, 0), X=Domain(0, 3.317451635), Y=Domain(0, 3.849979864), Z=Domain(0, 22.78045918)})
box_5 = Box({Plane=PlaneXY(-18.95972455, -18.6951654, 0), X=Domain(0, 17.23829924), Y=Domain(0, 5.640529356), Z=Domain(0, 8.670792979)})
item_2 = ListItem(List=detset_2, Index=number_slider, Wrap=True)  # disabled
merge = Merge(
    Data1=ColourSwatch(SwatchColor=RGB(79, 153, 34)),
    Data2=ColourSwatch(SwatchColor=RGB(0, 136, 255)),
    Data3=ColourSwatch(SwatchColor=RGB(234, 255, 0)),
    Data4=ColourSwatch(SwatchColor=RGB(140, 0, 255)),
    Data5=ColourSwatch(SwatchColor=RGB(255, 0, 0)))
merge_2 = Merge(Data1=box_4, Data2=box_3, Data3=box_5, Data4=box_2, Data5=box)
_2dpreview = Tensor2DPreview(Tensor2D=item_2, Range=Domain(0, 0), SaveAll=False)  # disabled
argb = SplitARGB(Colour=merge)  # -> Alpha, Red, Green, Blue
debox = DeconstructBox(Box=merge_2)  # -> Plane, X, Y, Z
preview = CustomPreview(Geometry=merge_2, Shader=merge)
num = Number(debox.X)
num_2 = Number(debox.Y)
num_3 = Number(debox.Z)
remap = RemapNumbers(Value=num_2, Source="0 to 20", Target=Domain(0, 1))  # -> Mapped, Clipped
remap_2 = RemapNumbers(Value=num_3, Source="0 to 20", Target=Domain(0, 1))  # -> Mapped, Clipped
remap_3 = RemapNumbers(Value=num, Source="0 to 20", Target=Domain(0, 1))  # -> Mapped, Clipped
panel = Panel("""6
15
2
15
6""")
featurets_2 = FeatureTensorSet(
    Feature0=remap_3.Mapped,
    Feature1=remap.Mapped,
    Feature2=remap_2.Mapped,
    Feature3=argb.Red,
    Feature4=argb.Green,
    Feature5=argb.Blue)
series = Series(Start=0, Step=1, Count=Slider(100, range=0..100))
network = ConstructNetwork(Layers=panel, Activation=0, Alpha=Slider(1.2, range=0..10), Seed=123)
noise = AddNoise(TensorSet=featurets_2, Amplitude=0.1, Seed=series, Constrain=Domain(0, 1))
tsview = TensorSetDisplay(TensorSet=noise, Range=Domain(0, 1))
mergets = MergeTSet(TensorSets=noise)
backprop = Backpropagation(
    ActivationNetwork=network,
    Input=mergets,
    Output=mergets,
    LearningRate=Slider(0.04, range=0..1),
    Momentum=0.001,
    Epoch=10,
    Iterations=Slider(10000, range=0..1000000))  # -> ActivationNetwork, Error
range = Range(Domain="0 to 1", Steps=10)
range_2 = Range(Domain="0 to 100", Steps=10)
trim = TrimNetwork(ActivationNetwork=backprop.ActivationNetwork, Trim="2")
crossref = CrossReference(ListA=range, ListB=range, CrossMode=1)  # -> ListA, ListB
crossref_2 = CrossReference(ListA=range_2, ListB=range_2, CrossMode=1)  # -> ListA, ListB
panel_2 = Panel(backprop.ActivationNetwork)
panel_3 = Panel(trim)
pt_2 = ConstructPoint(XCoordinate=crossref.ListA, YCoordinate=crossref.ListB, ZCoordinate=0)
pt_3 = ConstructPoint(XCoordinate=crossref_2.ListA, YCoordinate=crossref_2.ListB, ZCoordinate=0)
pdecon = Deconstruct(Point=pt_2)  # -> XComponent, YComponent, ZComponent
featurets_3 = FeatureTensorSet(Feature0=pdecon.XComponent, Feature1=pdecon.YComponent)
compute = Compute(ActivationNetwork=trim, Input=featurets_3)
tensorset_to_datatree = TensorSetToDataTree(TensorSet=compute)  # "TS->DT"
item_3 = ListItem(List=tensorset_to_datatree, Index=0, Wrap=True)  # -> Item, Item1, Item2, Item3, Item4, Item5
frgb = ColourRGBF(Alpha=1, Red=item_3.Item3, Green=item_3.Item4, Blue=item_3.Item5)
remap_4 = RemapNumbers(Value=item_3.Item1, Source=Domain(0, 1), Target="0 to 20")  # -> Mapped, Clipped
remap_5 = RemapNumbers(Value=item_3.Item2, Source=Domain(0, 1), Target="0 to 20")  # -> Mapped, Clipped
remap_6 = RemapNumbers(Value=item_3.Item, Source=Domain(0, 1), Target="0 to 20")  # -> Mapped, Clipped
box_6 = DomainBox(Base=graft(pt_3), X=remap_6.Mapped, Y=remap_4.Mapped, Z=remap_5.Mapped)
preview_2 = CustomPreview(Geometry=box_6, Shader=frgb)
