# Grasshopper definition Time Series.gh (Grasshopper 0.9.76)
# plug-ins: Anemone, Owl.Accord.GH, Owl.GH

nurbs = NurbsCurve(
    Vertices=[Point(-24.66338967, -5.582871534, 0), Point(-8.880685505, 24.62449619, 0), Point(-0.6655703696, 11.43727407, 0), Point(-5.457748603, -20.63968973, 0), Point(44.15043851, -30.24730222, 0), Point(52.95226971, 15.92280264, 0), Point(23.09155119, 6.604851473, 0), Point(24.02872986, -20.44543934, 0), Point(30.40946014, -45.25345748, 0), Point(5.961632992, -46.75910414, 0), Point(-2.701512023, -14.24346071, 0), Point(24.51094381, 0.6423981283, 0), Point(42.66424289, -11.34117055, 0), Point(50.72502769, -40.62868587, 0)],
    Degree=3,
    Periodic=False)  # -> Curve, Length, Domain
number_slider = Slider(8, range=0..10)
geo = Geometry(nurbs.Curve)
divlength = DivideLength(Curve=geo, Length=number_slider)  # -> Points, Tangents, Parameters

# ---- group: display vectors
lng = ListLength(List=divlength.Points)
series = Series(Start=0, Step=1, Count=lng)
int = Integer(series)
tag = TextTag3D(Location=divlength.Points, Text=int, Size=1, Justification=7)
vdisex = VectorDisplayEx(Point=divlength.Points, Vector=divlength.Tangents, Colour=RGB(0, 0, 0), Width=2)

# ---- group: pick indices
number_slider_2 = Slider(6, range=0..10)
lng_2 = ListLength(List=divlength.Tangents)
subtraction = Subtraction(A=lng_2, B=number_slider_2)
series_2 = Series(Start=0, Step=1, Count=expr("x+1", subtraction))
series_3 = Series(Start=series_2, Step=1, Count=number_slider_2)

# ----
item = ListItem(List=divlength.Tangents, Index=series_3, Wrap=True)
series_4 = Series(Start=Slider(0, range=0..100), Step=1, Count=Slider(5, range=0..10))

# ---- group: 1
item_2 = ListItem(List=item, Index=0, Wrap=True)  # -> Item1, Item
vec = Vector(item_2.Item1)

# ---- group: 5
item_3 = ListItem(List=item, Index=series_4, Wrap=True)
vec_2 = Vector(item_3)

# ---- group: normalization
unit = UnitVector(Vector=vec)
unit_2 = UnitVector(Vector=vec_2)
devec = DeconstructVector(Vector=unit_2)  # -> XComponent, YComponent, ZComponent
devec_2 = DeconstructVector(Vector=unit)  # -> XComponent, YComponent, ZComponent

# ----
panel = Panel("""0
1""")
weave = Weave(Pattern=panel, Stream0=devec.XComponent, Stream1=devec.YComponent, NullGaps=False)
weave_2 = Weave(Pattern=panel, Stream0=devec_2.XComponent, Stream1=devec_2.YComponent, NullGaps=False)

# ---- group: pack into a tensorset
datatree_to_tensorset = DataTreeToTensorSet(DataTree=weave)  # "DT->TS"
datatree_to_tensorset_2 = DataTreeToTensorSet(DataTree=weave_2)  # "DT->TS"

# ----
panel_2 = Panel("""10
16
2""")
series_5 = Series(Start=0, Step=1, Count=Slider(10, range=0..100))
network = ConstructNetwork(Layers=panel_2, Activation=Slider(1, range=0..1), Alpha=Slider(0.5, range=0..1), Seed=Slider(75399, range=0..100000))
noise = AddNoise(TensorSet=datatree_to_tensorset_2, Amplitude=0.1, Seed=series_5, Constrain="-1 to 1")
noise_2 = AddNoise(TensorSet=datatree_to_tensorset, Amplitude=0.1, Seed=series_5, Constrain="-1 to 1")
mergets = MergeTSet(TensorSets=noise_2)
mergets_2 = MergeTSet(TensorSets=noise)

# ---- group: 5 vectors
series_6 = Series(Start=0, Step=1, Count=Slider(5, range=0..10))
item_4 = ListItem(List=divlength.Tangents, Index=series_6, Wrap=True)
unit_3 = UnitVector(Vector=item_4)

# ----
backprop = Backpropagation(
    ActivationNetwork=network,
    Input=mergets,
    Output=mergets_2,
    LearningRate=0.01,
    Momentum=0.001,
    Epoch=10,
    Iterations=Slider(1000, range=0..100000))  # -> ActivationNetwork, Error

# ---- group: 5 points
item_5 = ListItem(List=divlength.Points, Index=series_6, Wrap=True)

# ----
item_6 = ListItem(List=item_5, Index=0, Wrap=True)  # -> Item1, Item
devec_3 = DeconstructVector(Vector=unit_3)  # -> XComponent, YComponent, ZComponent
merge = Merge(Data1=devec_3.XComponent, Data2=devec_3.YComponent)
tensor = ConstructTensor(Values=merge)
loop_start = LoopStart(N=Slider(100, range=0..100), D0=tensor, D1=flatten(item_6.Item1))  # -> port, Counter, Data, Data_2
division_length = Number(number_slider)
compute = Compute(ActivationNetwork=backprop.ActivationNetwork, Input=loop_start.Data)
detset = DeconstructTensorSet(TensorSet=compute)
detensor = DeconstructTensor(Tensor=detset)
detensor_2 = DeconstructTensor(Tensor=loop_start.Data)
item_7 = ListItem(List=detensor, Index=0, Wrap=True)  # -> Item, Item1
vec_3 = VectorXYZ(XComponent=item_7.Item, YComponent=item_7.Item1, ZComponent=0)  # -> Vector, Length
shift = ShiftList(List=detensor_2, Shift="2", Wrap="false")
unit_4 = UnitVector(Vector=vec_3.Vector)
amp = Amplitude(Vector=vec_3.Vector, Amplitude=division_length)
devec_4 = DeconstructVector(Vector=unit_4)  # -> XComponent, YComponent, ZComponent
merge_2 = Merge(Data1=flatten(shift), Data2=flatten(devec_4.XComponent), Data3=flatten(devec_4.YComponent))  # -> flatten(Result)
tensor_2 = ConstructTensor(Values=merge_2)
move = Move(Geometry=loop_start.Data_2, Motion=amp)  # -> Geometry, Transform
loop_end = LoopEnd(
    port=loop_start.port,
    Exit=False,
    Data=flatten(tensor_2),
    Data_2=flatten(move.Geometry),
    pausedState=False,
    state="Constant & Record",
    TimeOutVal=0)  # -> D0, D1
pline = PolyLine(Vertices=flatten(loop_end.D1), Closed=False)
