# Grasshopper definition Timer Expire.gh (Grasshopper 0.9.76)

c_script = CSharpScript(x=Button())  # -> out, A; inputs x: Boolean
# ---------- c_script: C# ----------
    if (blocking)    {
      A = counter;
      return;
    }

    if (x == true){
      blocking = true;
      runthis();
    }

    counter += 1;
    A = counter;
# ---------- c_script: C# additional code ----------
  int counter = 0;
  bool blocking = false;

  System.Timers.Timer nt = new System.Timers.Timer(1000);

  public void runthis() {
    nt.AutoReset = false;
    nt.Elapsed += ElapsedTimer;
    nt.Start();
  }

  public void ElapsedTimer(object sender, System.Timers.ElapsedEventArgs e) {
    System.Action act = new System.Action(ExpireComp);
    Rhino.RhinoApp.MainApplicationWindow.Invoke(act);
    nt.Elapsed -= ElapsedTimer;
    blocking = false;
  }

  public void ExpireComp(){
    this.Component.ExpireSolution(true);
  }
# ---------- end c_script ----------
panel = Panel(c_script.A)
