# Grasshopper definition k-Means.gh (Grasshopper 0.9.76)
# plug-ins: Owl.GH

number_slider = Slider(300, range=0..1000)
pop2d = Populate2D(
    Region={Plane=PlaneXY(-7.236468588, -4.947107966, 0), Size=Domain2(u=0..41.57832339, v=0..32.1665927)},
    Count=number_slider,
    Seed=1)
pop2d_2 = Populate2D(
    Region={Plane=PlaneXY(35.90559234, 24.44084949, 0), Size=Domain2(u=0..31.54822099, v=0..27.22457283)},
    Count=number_slider,
    Seed=1)
pop2d_3 = Populate2D(
    Region={Plane=PlaneXY(-28.33845182, 24.54965204, 0), Size=Domain2(u=0..44.99057838, v=0..24.04537409)},
    Count=number_slider,
    Seed=1)
merge = Merge(Data1=pop2d, Data2=pop2d_2, Data3=pop2d_3)
featurets = FeatureTensorSet(Feature0=merge)

detset = DeconstructTensorSet(TensorSet=featurets)
panel = Panel(detset)
kmeans = KMeansClustering(Data=featurets, Clusters=3, Iterations=Slider(10, range=0..10), Seed=123)  # -> Clusters, Indices
item = ListItem(List=merge, Index=kmeans.Indices, Wrap=True)
tstat = TreeStatistics(Tree=item)  # -> Paths, Length, Count
random = Random(Range=Domain(0, 1), Number=tstat.Count, Seed=2)
hsl = ColourHSL(Alpha=1, Hue=random, Saturation=1, Luminance=0.5)
preview = CustomPreview(Geometry=item, Shader=graft(hsl))

number_slider_2 = Slider(3, range=0..10)
series = Series(Start=0, Step=1, Count=Slider(20, range=0..100))
pick = PickTensor(TensorSet=featurets, Indices=series, Wrap=True)
tensorset = ConstructTensorSet(Tensors=pick)
kmeansex = KMeansClusteringEx(
    Data=featurets,
    Seeds=tensorset,
    Iterations=Slider(100, range=0..100),
    Energy=4.94e-324,
    Weigths=[Slider(1, range=0..1), Slider(0.6031, range=0..1), Slider(0, range=0..1)])  # -> Clusters, Indices, Iterations
item_2 = ListItem(List=merge, Index=kmeansex.Indices, Wrap=True)
tstat_2 = TreeStatistics(Tree=item_2)  # -> Paths, Length, Count
random_2 = Random(Range=Domain(0, 1), Number=tstat_2.Count, Seed=Slider(23423, range=0..100000))
hsl_2 = ColourHSL(Alpha=1, Hue=random_2, Saturation=1, Luminance=0.5)
preview_2 = CustomPreview(Geometry=item_2, Shader=graft(hsl_2))
